# Dynamo graph testFile.dyn (Dynamo 3.3.0.6316)

code_block = CodeBlock { ""; ""; }
code_block_2 = CodeBlock { ""; 0.2; 10; }
fluxMaterial = DynaFlux.Build.FluxMaterial.FluxMaterial(name=code_block_2.out0, thermalConductivity=code_block_2.out1, thickness=code_block_2.out2)
code_block_3 = CodeBlock { ""; 0.2; 10; }
fluxMaterial_2 = DynaFlux.Build.FluxMaterial.FluxMaterial(name=code_block_3.out0, thermalConductivity=code_block_3.out1, thickness=code_block_3.out2)
code_block_4 = CodeBlock { ""; 0.2; 10; }
fluxMaterial_3 = DynaFlux.Build.FluxMaterial.FluxMaterial(name=code_block_4.out0, thermalConductivity=code_block_4.out1, thickness=code_block_4.out2)
list_create = List.Create(item0=fluxMaterial, item1=fluxMaterial_2, item2=fluxMaterial_3)
fluxConstruction = DynaFlux.Build.FluxConstruction.FluxConstruction(id=code_block.out0, name=code_block.out1, materials=list_create)
create = DynaFlux.Build.FluxSurface.Create(construction=fluxConstruction)  # unwired: face
code_block_5 = CodeBlock { 5; 4; }
byWidthLength = Rectangle.ByWidthLength(width=code_block_5.out0, length=code_block_5.out1)
code_block_6 = CodeBlock { 3; }
extrude = Curve.Extrude(curve=byWidthLength, distance=code_block_6)
code_block_7 = CodeBlock(x=extrude) { x.Faces; }
code_block_8 = CodeBlock(x=code_block_7) { x.Edges; }
